# Grasshopper definition CHORD_BLEND_GH.gh (Grasshopper 1.0.8)

crv = Curve(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)
list = ValueList({"G0": 0, "G1": 1, "G2": 2}, selected="G2")
chordblend = ChordBlend(C=crv, Ch=Slider(10, range=0..60), R=Slider(4, range=0..10), S=Slider(1.1, range=0..10), M=list)  # -> C, P, B
#   port R: overwrites Ch
#   port M: 0 = arc 1 = G1 2 = G2
# ---------- chordblend: Python ----------
import Rhino
import rhinoscriptsyntax as rs
import math
import Grasshopper.Kernel as gh
from Grasshopper import DataTree
from Grasshopper.Kernel.Data import GH_Path

__author__ = "Max"
__version__ = "0.1"
ghenv.Component.Name = "Chord Blend"
ghenv.Component.NickName = "ChordBlend"
ghenv.Component.Description = "Smoothes corners of polylines with arc (G1), blend (G1), or G2 Bézier transitions using chord length."

# Outputs
B = []
P = DataTree[object]()
C_out = None

# inputs
if R and R > 0:
    Ch = R * math.sqrt(2)


# --- Corner Methods ---

def arc_fillet(p0, p1, p2, Ch):
    v1 = p0 - p1
    v2 = p2 - p1
    len1 = v1.Length
    len2 = v2.Length
    if not v1.Unitize() or not v2.Unitize():
        return None, None, None
    angle = Rhino.Geometry.Vector3d.VectorAngle(v1, v2)
    if angle < 1e-6 or angle > math.pi - 1e-6:
        return None, None, None
    try:
        d = Ch / (2.0 * math.sin(angle / 2.0))
    except ZeroDivisionError:
        return None, None, None
    if d > len1 or d > len2:
        return None, None, None
    pt1 = p1 + v1 * d
    pt2 = p1 + v2 * d
    tangent = -v1
    arc = Rhino.Geometry.Arc(pt1, tangent, pt2)
    return arc.ToNurbsCurve(), pt1, pt2 if arc.IsValid else (None, None, None)

def blend_g1(p0, p1, p2, Ch, strength, i):
    v1 = p1 - p0
    v2 = p2 - p1
    if not v1.Unitize() or not v2.Unitize():
        return None, None, None
    angle = Rhino.Geometry.Vector3d.VectorAngle(-v1, v2)
    try:
        d = Ch / (2.0 * math.sin(angle / 2.0))
    except ZeroDivisionError:
        return None, None, None
    if d > (p1 - p0).Length or d > (p2 - p1).Length:
        return None, None, None
    pt1 = p1 + (-v1) * d
    pt2 = p1 + v2 * d
    tan1 = v1
    tan2 = v2
    cp0 = pt1
    cp3 = pt2

    angle = Rhino.Geometry.Vector3d.VectorAngle(-v1, v2)
    norm = angle / math.pi
    adaptive = (1 - norm)**2
    local_strength = (strength + 1) * (0.4 + 0.6 * adaptive)

    cp1 = pt1 + tan1 * (local_strength * Ch)
    cp2 = pt2 - tan2 * (local_strength * Ch)


    curve = Rhino.Geometry.NurbsCurve.Create(False, 3, [cp0, cp1, cp2, cp3])
    if curve and curve.IsValid:
        path = GH_Path(i)
        for pt in [cp0, cp1, cp2, cp3]:
            P.Add(pt, path)
        return curve, pt1, pt2
    return None, None, None

def blend_g2(p0, p1, p2, Ch, strength, i):
    v_in = p1 - p0
    v_out = p2 - p1
    if not v_in.Unitize() or not v_out.Unitize():
        return None, None, None
    angle = Rhino.Geometry.Vector3d.VectorAngle(-v_in, v_out)
    try:
        d = Ch / (2.0 * math.sin(angle / 2.0))
    except ZeroDivisionError:
        return None, None, None
    if d > (p1 - p0).Length or d > (p2 - p1).Length:
        return None, None, None
    pt1 = p1 + (-v_in) * d
    pt2 = p1 + v_out * d

    angle = Rhino.Geometry.Vector3d.VectorAngle(-v_in, v_out)
    norm = angle / math.pi
    adaptive = (1 - norm)**2
    local_strength = (strength + 1) * (0.4 + 0.6 * adaptive)


    a_in = local_strength * Ch
    a_out = local_strength * Ch

    c0 = pt1
    c5 = pt2
    c1 = c0 + (a_in / 5.0) * v_in
    c2 = 2 * c1 - c0
    c4 = c5 - (a_out / 5.0) * v_out
    c3 = 2 * c4 - c5
    curve = Rhino.Geometry.NurbsCurve.Create(False, 5, [c0, c1, c2, c3, c4, c5])
    if curve and curve.IsValid:
        path = GH_Path(i)
        for pt in [c0, c1, c2, c3, c4, c5]:
            P.Add(pt, path)
        return curve, pt1, pt2
    return None, None, None

# --- Helpers ---

def extract_polyline_points(curve):
    if not curve or not curve.IsValid:
        return None
    success, poly = curve.TryGetPolyline()
    pts = list(poly.ToArray()) if success else list(curve.ToPolyline().ToArray())
    if curve.IsClosed and pts[0].DistanceTo(pts[-1]) < 1e-9:
        pts = pts[:-1]
    return pts

def build_segments(pts, trims, closed):
    segs = []
    n = len(trims)
    if closed:
        for i in range(n):
            a = trims[i][1]
            b = trims[(i+1)%n][0]
            segs.append(Rhino.Geometry.Line(a, b).ToNurbsCurve())
    else:
        segs.append(Rhino.Geometry.Line(pts[0], trims[0][0]).ToNurbsCurve())
        for i in range(n-1):
            a = trims[i][1]
            b = trims[i+1][0]
            segs.append(Rhino.Geometry.Line(a, b).ToNurbsCurve())
        segs.append(Rhino.Geometry.Line(trims[-1][1], pts[-1]).ToNurbsCurve())
    return segs

def join_curves(curves):
    joined = Rhino.Geometry.Curve.JoinCurves(curves)
    return joined[0] if joined and len(joined) == 1 else None

# --- MAIN ---

curve = rs.coercecurve(C)
if not curve or not curve.IsValid:
    ghenv.Component.AddRuntimeMessage(gh.GH_RuntimeMessageLevel.Error, "Missing or invalid input curve.")
else:
    pts = extract_polyline_points(curve)
    if pts and len(pts) >= 3:
        is_closed = curve.IsClosed
        n = len(pts)
        trim_pts = []
        blends = []
        loop = range(n) if is_closed else range(1, n-1)
        for i in loop:
            p0 = pts[(i - 1) % n]
            p1 = pts[i]
            p2 = pts[(i + 1) % n]
            if M == 0:
                b, a, c = arc_fillet(p0, p1, p2, Ch)
            elif M == 1:
                b, a, c = blend_g1(p0, p1, p2, Ch, S, i)
            elif M == 2:
                b, a, c = blend_g2(p0, p1, p2, Ch, S, i)
            else:
                b, a, c = None, None, None
            if b and a and c:
                blends.append(b)
                trim_pts.append((a, c))
        segments = build_segments(pts, trim_pts, is_closed)
        final = []
        if is_closed:
            for i in range(len(blends)):
                final.append(blends[i])
                final.append(segments[i])
        else:
            final.append(segments[0])
            for i in range(len(blends)):
                final.append(blends[i])
                final.append(segments[i+1])
        C_out = join_curves(final)
        B = blends

# Output
C = C_out
# ---------- end chordblend ----------
crv_2 = Curve(chordblend.C)
pt = Point(chordblend.P)
crv_3 = Curve(chordblend.B)
