# Grasshopper definition GORE PRODUCTION.gh (Grasshopper 1.0.7)

gores = Slider(24, range=0..100)
diameter_in_mm = Slider(1300, range=0..10000)
division = Division(A=diameter_in_mm, B=2)
division_2 = Division(A=division, B=2)
multiplication = Multiplication(A=division, Pi=3.141592654)
multiplication_2 = Multiplication(A=division_2, Pi=3.141592654)
multiplication_3 = Multiplication(A=multiplication_2, B=-1)
sampling_steps = Slider(100, range=0..100)
division_3 = Division(A=multiplication, B=sampling_steps)
addition = Addition(A=sampling_steps, B=1)

sph = Sphere(Base=PlaneXY(0, 0, 0), Radius=division)  # disabled
divide = DivideDomain²(Domain=sph, UCount=gores, VCount=1)  # disabled
subsrf = Isotrim(Surface=sph, Domain=divide)  # disabled
item = ListItem(List=subsrf, Index=0, Wrap=True)  # disabled
edges = BrepEdges(Brep=item)  # -> Naked, Interior, NonManifold; disabled
len = Length(Curve=edges.Naked)  # disabled

series = Series(Start=multiplication_3, Step=division_3, Count=addition)
expression = Expression(R=division, n=gores, x=series, Expression="R*(tan(π/n))*(cos(x/R))")
expression_2 = Expression(R=division, n=gores, x=series, Expression="R*(π/n)*(cos(x/R))")
pt = ConstructPoint(XCoordinate=series, YCoordinate=expression_2, ZCoordinate=0)
X = UnitX(Factor=1)
pt_2 = Point(Point(0, 0, 0))
intcrv = Interpolate(Vertices=pt, Degree=3, Periodic=False, KnotStyle=1)  # -> Curve, Length, Domain
line = LineSDL(Start=pt_2, Direction=X, Length=1)
mirror = MirrorCurve(Geometry=intcrv.Curve, Curve=line, Tangent=True)
len_2 = Length(Curve=mirror)
merge = Merge(Data1=intcrv.Curve, Data2=mirror)
geo = Geometry(merge)
